# Grasshopper definition 03_ProcessSerialization.gh (Grasshopper 1.0.7)

# ----
# Workpiece Geoemtry
workpieces_brep = Brep([<brep referenced from the Rhino model> x8])

# ----
# Grasp Definition (Workpiece Origin)
tool_frame_on_workpieces_srf = Surface([<surface referenced from the Rhino model> x8])
tool_frame_on_workpieces_pln = Plane(tool_frame_on_workpieces_srf)

# ----
# Workpiece Pickup Location
pickup_tool_tip_frame_srf = Surface(<surface referenced from the Rhino model>)
pickup_tool_tip_frame_pln = Plane(pickup_tool_tip_frame_srf)

# ----
# Tool Definition
brep_tool_geometry = Brep([<brep referenced from the Rhino model> x4])
tool_frame_srf = Surface(<surface referenced from the Rhino model>)
tool_frame_pln = Plane(tool_frame_srf)

# ----
# Approach / Retract Direction
approach_direction_crv = Curve([<curve referenced from the Rhino model> x8])
retract_direction_crv = Curve([<curve referenced from the Rhino model> x8])
end = EndPoints(Curve=approach_direction_crv)  # -> Start, End
end_2 = EndPoints(Curve=retract_direction_crv)  # -> Start, End
vec2pt = Vector2Pt(PointA=end.Start, PointB=end.End, Unitize=False)  # -> Vector, Length
vec2pt_2 = Vector2Pt(PointA=end_2.Start, PointB=end_2.End, Unitize=False)  # -> Vector, Length
approach_direction_vec = Vector(vec2pt.Vector)
retract_direction_vec = Vector(vec2pt_2.Vector)

python = GhPythonScript(reload=Button(), module_names="compas_fab")  # -> out; inputs module_names: list
# ---------- python: Python ----------
#from compas_ghpython import unload_modules
#
#if reload:
#    for module_name in module_names:
#        unload_modules(module_name)

from compas_ghpython import unload_modules

unload_modules('compas_fab')
# ---------- end python ----------
workpieces_brep_2 = Brep(workpieces_brep)

# ----
# Load Robot
load = Button()
python_2 = PythonScript(load=load)  # -> robot
# ---------- python_2: Python ----------
from scriptcontext import sticky as st

import os
import compas

from compas.robots import RobotModel
from compas.robots.resources import LocalPackageMeshLoader

from compas_fab.robots import Robot
from compas_fab.robots import RobotSemantics
from compas_ghpython.artists import RobotModelArtist


# Robot meshes are usually in meters
# Set a high precision to prevent parsing errors
# and configure Rhino itself in meters
compas.PRECISION = '12f'

# Store robot in component-based key
robot_key = 'robot_{}'.format(str(ghenv.Component.InstanceGuid))

if robot_key not in st:
    st[robot_key] = None

if load:
    canvas = ghenv.Component.OnPingDocument()

    # Load robot
    package_folder = os.path.join(os.path.dirname(canvas.FilePath), '../../robots')
    urdf_file = os.path.join(package_folder, 'abb_irb4600_40_255', 'urdf', 'abb_irb4600_40_255.urdf')


    model = RobotModel.from_urdf_file(urdf_file)
    model.load_geometry(LocalPackageMeshLoader(package_folder, 'abb_irb4600_40_255'))


    artist = RobotModelArtist(model)
#    robot = Robot(model, artist, semantics=semantics)
    robot = Robot(model, artist)

    st[robot_key] = robot

robot = st[robot_key]
# ---------- end python_2 ----------
robot = Data(python_2)

panel = Panel(python)
clash = Clash(FirstSet=workpieces_brep_2, SecondSet=workpieces_brep_2, Distance="0.001", L=100)  # -> ClashCount, ClashPoints, ClashRadii, FirstIndex, SecondIndex
brep_tool_geometry_2 = Brep(brep_tool_geometry)
tool_frame_pln_2 = Plane(tool_frame_pln)

# ---- group: forward kinematics
# Define Initial Config
a1 = Slider(0, range=-360..360)
a2 = Slider(0, range=-360..360)
a4 = Slider(0, range=-360..360)
a5 = Slider(0, range=-360..360)
a3 = Slider(0, range=-360..360)
a6 = Slider(0, range=-360..360)
robot_configuration = GhPythonScript(robot=python_2)  # -> out, zero_configuration
# ---------- robot_configuration: Python ----------
zero_configuration = robot.zero_configuration()
print(zero_configuration)

print('Joints in robot.get_configurable_joints():')
for joint in robot.get_configurable_joints(None):
    print ('%s (%s - %s)' % (joint.name, joint.limit.lower, joint.limit.upper))
# ---------- end robot_configuration ----------
forward_kinematics = PythonScript(robot=robot, joint_1=a1, joint_2=a2, joint_3=a3, joint_4=a4, joint_5=a5, joint_6=a6)  # -> configuration
# ---------- forward_kinematics: Python ----------
import math
from compas.robots import Configuration

if robot:
    joint_values = [
        math.radians(joint_1),
        math.radians(joint_2),
        math.radians(joint_3),
        math.radians(joint_4),
        math.radians(joint_5),
        math.radians(joint_6),
        ]
        
    joint_names = [
        'joint_1',
        'joint_2',
        'joint_3',
        'joint_4',
        'joint_5',
        'joint_6',
        ]
    configuration = Configuration.from_prismatic_and_revolute_values(joint_values[0:3],joint_values[3:], joint_names)
# ---------- end forward_kinematics ----------
panel_2 = Panel(robot_configuration.out)
merge = GhPythonScript(configuration_old=robot_configuration.zero_configuration, configuration_new=forward_kinematics)  # -> out, configuration_merged
# ---------- merge: Python ----------
configuration_merged = configuration_old.copy()
for key, value in configuration_new.items():
    print (key)
    configuration_merged[key] = value
# ---------- end merge ----------

# ----
tool = GhPythonScript(tool_id="g1", tool_meshes=brep_tool_geometry_2, frame_in_tool0_frame=tool_frame_pln_2)  # -> out, tool; inputs tool_meshes: list of Mesh
# ---------- tool: Python ----------
from compas_fab.robots import Tool
from compas.robots import ToolModel, RobotModel, Link
from compas_rhino.geometry import RhinoPlane
from compas_rhino.geometry import RhinoMesh

# Convert Rhino Geometry to compas geometry
frame_in_tool0_frame = RhinoPlane.from_geometry(frame_in_tool0_frame).to_compas_frame()

mesh_gripper_base = []
for mesh in tool_meshes:   
    mesh_gripper_base.append(RhinoMesh.from_geometry(mesh).to_compas())

# Use default ToolModel constructor
tool_model = ToolModel(None, frame_in_tool0_frame, name = tool_id)

# Remove default link
hardcoded_link = tool_model.get_link_by_name('attached_tool_link')
if hardcoded_link is not None:
    tool_model.links.remove(hardcoded_link)

# Add a custom link
gripper_base = tool_model.add_link('gripper_base', mesh_gripper_base)
tool = Tool.from_tool_model(tool_model)
# ---------- end tool ----------
tool_frame_on_workpieces_pln_2 = Plane(tool_frame_on_workpieces_pln)

# ----
# Define Workpiece (Mesh / ID)
workpieces_brep_3 = Brep(workpieces_brep)
lng = ListLength(List=workpieces_brep_3)
mesh = MeshBrep(
    Brep=workpieces_brep_3,
    Settings={GridMaxCount=0, GridMinCount=16, JaggedSeams=False, MaxEdgeLength=0, MinEdgeLength=0.0001, MinTolerance=0, Refine=True, RefineAngle=0, RelativeTolerance=0.65, SimplePlanes=False, Tolerance=0})
series = Series(Start=0, Step=1, Count=lng)
int = Integer(series)
mesh_2 = Mesh(mesh)
concat = Concatenate(FragmentA="b", FragmentB=int)
beam_ids = Text(concat)
workpiece = GhPythonScript(mesh=mesh_2, id=beam_ids)  # -> out, workpiece; inputs mesh: Mesh
# ---------- workpiece: Python ----------
from compas_fab.planning import Workpiece
from compas_rhino.geometry import RhinoMesh

workpiece = Workpiece()

#Mesh
compas_mesh = RhinoMesh.from_geometry(mesh).to_compas()
workpiece.mesh = compas_mesh

workpiece.name = id
# ---------- end workpiece ----------

beam_ids_2 = Text(beam_ids)
python_3 = GhPythonScript(beam_ids=beam_ids_2, x=clash.FirstIndex, y=clash.SecondIndex)  # -> out, a; inputs beam_ids: list, x: list, y: list
# ---------- python_3: Python ----------
a = []
a.append(('b0','b1'))
a.append(('b1','b2'))
import ghpythonlib.treehelpers as th
import Grasshopper as gh
 
tree = gh.DataTree[object]()

for i, beam_id in enumerate(beam_ids):
    tree.Add(None, gh.Kernel.Data.GH_Path(i, ))
    print('Beam %s : '% beam_id)
    for a , b in zip (x,y):
        if i==a and a > b:
            allowed_collision_pair = (beam_ids[a], beam_ids[b])
            print ('  (%s - %s)'%(allowed_collision_pair))
            tree.Add(allowed_collision_pair, gh.Kernel.Data.GH_Path(i, ))

a = tree
# ---------- end python_3 ----------
tool_frame_pln_3 = Plane(tool_frame_pln)
panel_3 = Panel(python_3.a)
xy = XYPlane(Origin=Point(0, 0, 0))
pickup_tool_tip_frame_pln_2 = Plane(pickup_tool_tip_frame_pln)
orient = Orient(Geometry=xy, Source=tool_frame_pln_3, Target=tool_frame_on_workpieces_pln_2)  # -> Geometry, Transform
beam_ids_3 = Text(beam_ids)
robot_frame_at_assembled = Plane(orient.Geometry)

# ----
# FreeMotion: FixedPickupTarget
xy_2 = XYPlane(Origin=Point(0, 0, 0))
orient_2 = Orient(Geometry=xy_2, Source=tool_frame_pln_2, Target=pickup_tool_tip_frame_pln_2)  # -> Geometry, Transform
pickup_tool_base_frame_pln = Plane(orient_2.Geometry)
lng_2 = ListLength(List=beam_ids_3)
list = ValueList({"LinearMovement", "FreeMovement"}, selected="FreeMovement")
repeat = RepeatData(Data=pickup_tool_base_frame_pln, Length=lng_2)
movement = Movement(robot_target=repeat, movement_type=list)  # -> out, action

# ----
# FreeMotion: To Before Approach Location
approach_direction_vec_2 = Vector(approach_direction_vec)
allowed_collision_beam_neighbours = Data(python_3.a)
rev = Reverse(Vector=approach_direction_vec_2)
move = Move(Geometry=robot_frame_at_assembled, Motion=rev)  # -> Geometry, Transform
list_2 = ValueList({"LinearMovement", "FreeMovement"}, selected="FreeMovement")
movement_2 = Movement(robot_target=move.Geometry, allowed_collision_pairs=allowed_collision_beam_neighbours, movement_type=list_2)  # -> out, action

# ----
# LinearMotion: Gripper to Retracted Location
retract_direction_vec_2 = Vector(retract_direction_vec)
allowed_collision_beam_neighbours_2 = Data(python_3.a)
list_3 = ValueList({"LinearMovement", "FreeMovement"}, selected="LinearMovement")
move_2 = Move(Geometry=robot_frame_at_assembled, Motion=retract_direction_vec_2)  # -> Geometry, Transform
movement_3 = Movement(robot_target=move_2.Geometry, allowed_collision_pairs=allowed_collision_beam_neighbours_2, movement_type=list_3)  # -> out, action

# ----
# Gripper Open
beam_ids_4 = Text(beam_ids)
lng_3 = ListLength(List=beam_ids_4)
repeat_2 = RepeatData(Data="g1", Length=lng_3)
open_gripper = GhPythonScript(tool_id=repeat_2)  # -> out, action
# ---------- open_gripper: Python ----------
from compas_fab.planning import OpenGripper
from compas_rhino.geometry import RhinoPlane

action = OpenGripper()
action.tool_id = tool_id
# ---------- end open_gripper ----------

# ----
# LinearMotion: To Assembled Location
allowed_collision_beam_neighbours_3 = Data(python_3.a)
list_4 = ValueList({"LinearMovement", "FreeMovement"}, selected="LinearMovement")
movement_4 = Movement(robot_target=robot_frame_at_assembled, allowed_collision_pairs=allowed_collision_beam_neighbours_3, movement_type=list_4)  # -> out, action

# ----
# Visualize Initial Config
show_end_effector_frame = BooleanToggle(True)
show_visual = BooleanToggle(True)
visualize = PythonScript(
    robot=robot,
    configuration=merge.configuration_merged,
    show_visual=show_visual,
    show_end_effector_frame=show_end_effector_frame)  # -> visual, collision, frames, ee_frame, base_frame, ee_frame_rhino
# ---------- visualize: Python ----------
"""Visualizes a robot.
    Inputs:
        robot: The robot
        configuration: :class:`compas_fab.robots.Configuration`
            The robot's full configuration to display.
        show_visual: bool
           Whether or not to show the robot's visual meshes.
        show_collision: bool
           Whether or not to show the robot's collision meshes.
        show_frames: bool
           Whether or not to show the robot's joint frames.
        show_base_frame: bool
           Whether or not to show the robot's base frame.
        show_end_effector_frame: bool
            Whether or not to show the robot's end-effector frame.
    Output:
        visual: The robot's visual meshes.
        collision: The robot's collision meshes.
        frames: The robot's joint frames.
        base_frame: The robot's base frame.
        ee_frame: The robot's end-effector frame.
"""
from __future__ import print_function
from compas_ghpython.artists import FrameArtist

if robot and configuration:
    group = group or robot.main_group_name if robot.semantics else None

    robot.update(configuration, group, visual=show_visual, collision=show_collision)

    if show_visual:
        visual = robot.artist.draw_visual()

    if show_collision:
        collision = robot.artist.draw_collision()

    if show_frames:
        axes = robot.transformed_axes(configuration, group)
        frames = robot.transformed_frames(configuration, group)

    if show_base_frame:
        frames = robot.transformed_frames(configuration, group)
        base_frame = frames[0]

    if show_end_effector_frame:
        ee_frame = robot.forward_kinematics(configuration, group)
        ee_frame_rhino = FrameArtist(ee_frame).draw()
        print("End-effector", ee_frame)
# ---------- end visualize ----------
brep_tool_geometry_3 = Brep(brep_tool_geometry)
orient_3 = Orient(Geometry=brep_tool_geometry_3, Source=PlaneXY(0, 0, 0), Target=visualize.ee_frame_rhino)  # -> Geometry, Transform
attached_tool = Geometry(orient_3.Geometry)
robot_2 = Geometry(visualize.visual)

# ----
# Gripper Close
panel_4 = Panel("g1")
close_gripper = GhPythonScript(tool_id=panel_4, workpiece_id=beam_ids_3)  # -> out, action
# ---------- close_gripper: Python ----------
from compas_fab.planning import CloseGripper
from compas_rhino.geometry import RhinoPlane

action = CloseGripper()
action.tool_id = tool_id
if workpiece_id is not None:
    action.attached_workpiece_id = workpiece_id
    if workpiece_grasp is not None:
        action.attached_workpiece_grasp = workpiece_grasp
# ---------- end close_gripper ----------

# ----
# Load Workpiece to the Pickup Location
load_workpiece = GhPythonScript(workpiece_id=beam_ids_3, workpiece_frame=pickup_tool_tip_frame_pln_2)  # -> out, action
# ---------- load_workpiece: Python ----------
from compas_fab.planning import LoadWorkpiece
from compas_rhino.geometry import RhinoPlane

action = LoadWorkpiece()
action.workpiece_id = workpiece_id
action.frame = RhinoPlane.from_geometry(workpiece_frame).to_compas_frame()
# ---------- end load_workpiece ----------

initial_config_ee_frame = Data(visualize.ee_frame)
merge_2 = Merge(
    Data1=graft(movement.action),
    Data2=graft(load_workpiece.action),
    Data3=graft(close_gripper.action),
    Data4=graft(movement_2.action),
    Data5=graft(movement_4.action),
    Data6=graft(open_gripper.action),
    Data7=graft(movement_3.action))  # -> flatten(Result)
# AssemblyProcess
# Flow Chart: FreeMotion: 	FixedPickupTarget
# GripperClose: 	BeamID, Grasp
# FreeMotion: 	BeforeApproachTarget
# LinearMotion: 	FinalTarget
# GripperOpen: 	BeamID
# LinearMotion: 	RetractTarget
assemblyprocess = GhPythonScript(
    workpieces=workpiece.workpiece,
    tool=tool.tool,
    assembly_sequence=beam_ids,
    actions=merge_2,
    robot_initial_configuration=merge.configuration_merged,
    robot_initial_frame=initial_config_ee_frame)  # -> out, process; inputs workpieces: list, assembly_sequence: list, actions: list
# ---------- assemblyprocess: Python ----------
from compas_fab.planning import AssemblyProcess

process = AssemblyProcess()
for workpiece in workpieces:
    process.workpieces[workpiece.name] = workpiece
process.tool = tool
process.assembly_sequence = assembly_sequence
process.actions = actions

process.robot_initial_frame = robot_initial_frame
process.robot_initial_configuration = robot_initial_configuration
# ---------- end assemblyprocess ----------
python_4 = GhPythonScript(process=assemblyprocess.process)  # -> out, initial_state
# ---------- python_4: Python ----------
initial_state = process.get_initial_state()
#self = process
#from compas_fab.planning.state import SceneState
#from compas.geometry import Frame
#
#scene_state = SceneState(self.workpiece_ids, [self.tool_id])
#
#
#for workpiece_id in self.workpiece_ids:
#    scene_state.workpiece_states[workpiece_id].frame = self.workpiece_storage_frame.get(workpiece_id, Frame.worldXY())
#
## Set initial state of tool
#scene_state.tool_states[self.tool_id].frame = self.robot_initial_frame
#
## Set initial state of robot
#scene_state.robot_state.frame = self.robot_initial_frame
#scene_state.robot_state.configuration = self.robot_initial_configuration
#print (scene_state.data)
# ---------- end python_4 ----------

# ----
# Serialization
panel_5 = Panel("process")
auto_path = GhPythonScript(filename=panel_5)  # -> json_path
# ---------- auto_path: Python ----------
from Rhino.RhinoDoc import ActiveDoc
import os
json_path = os.path.split(ActiveDoc.Path)[0] + os.path.sep + filename +".json"
pickle_path = os.path.split(ActiveDoc.Path)[0] + os.path.sep + filename +".pickle"
# ---------- end auto_path ----------
save = Button()
save_compas_json = GhPythonScript(object=assemblyprocess.process, json_path=auto_path, output=save)  # -> out, json_path
# ---------- save_compas_json: Python ----------
if output:
    from compas.utilities import DataDecoder, DataEncoder
    import json
    with open(json_path, 'w') as f:
        json.dump(object, f, cls=DataEncoder, indent=4, sort_keys=True)
# ---------- end save_compas_json ----------
load_compas_json = GhPythonScript(json_path=save_compas_json.json_path)  # -> out, object
# ---------- load_compas_json: Python ----------
from compas.utilities import DataDecoder, DataEncoder
import json
with open(json_path, 'r') as f:
    object = json.load(f, cls=DataDecoder)
# ---------- end load_compas_json ----------

auto_path_2 = GhPythonScript(filename="initial_state")  # -> json_path; same code as auto_path
save_2 = Button()
save_compas_json_2 = GhPythonScript(object=python_4.initial_state, json_path=auto_path_2, output=save_2)  # -> out, json_path; same code as save_compas_json
state_to_visualize = Slider(13, range=0..32)

# ----
# Visualisation
show_end_effector_frame_2 = BooleanToggle(False)
show_base_frame = BooleanToggle(False)
show_collision = BooleanToggle(False)
show_frames = BooleanToggle(False)
show_visual_2 = BooleanToggle(True)
visualize_2 = PythonScript(
    show_visual=show_visual_2,
    show_collision=show_collision,
    show_frames=show_frames,
    show_base_frame=show_base_frame,
    show_end_effector_frame=show_end_effector_frame_2)  # -> visual, collision, frames, ee_frame, base_frame
# ---------- visualize_2: Python ----------
from __future__ import print_function
from compas_ghpython.artists import RobotModelArtist
artist = RobotModelArtist(tool_model)
visual = artist.draw_visual()
collision = artist.draw_collision()
# ---------- end visualize_2 ----------
draw = GhPythonScript(frames=[visualize_2.frames, visualize_2.ee_frame, visualize_2.base_frame], scale=Slider(0.1, range=0..1))  # -> P, V, C, W; inputs frames: list
# ---------- draw: Python ----------
from System.Drawing import Color
from compas_ghpython.utilities import draw_frame

red = Color.FromArgb(255, 0, 0)
green = Color.FromArgb(0, 255, 0)
blue = Color.FromArgb(0, 0, 255)

P = []
V = []
C = []

scale = float(scale)

for frame in frames:
    if not frame:
        continue
    plane = draw_frame(frame)
    P += [plane.Origin] * 3
    V.append(plane.XAxis * scale)
    V.append(plane.YAxis * scale)
    V.append(plane.ZAxis * scale)
    C += [red, green, blue]

W = 3
# ---------- end draw ----------
geo = Geometry(visualize_2.visual)
geo_2 = Geometry(visualize_2.collision)
vdisex = VectorDisplayEx(Point=draw.P, Vector=draw.V, Colour=draw.C, Width=draw.W)

# ==== cluster Movement
robot_target = ClusterInput()
allowed_collision_pairs = ClusterInput()
fixed_configuration = ClusterInput()
movement_type = ClusterInput()
movement = GhPythonScript(
    robot_target=graft(robot_target),
    allowed_collision_pairs=allowed_collision_pairs,
    fixed_configuration=fixed_configuration,
    movement_type=movement_type)  # -> out, flatten(action); inputs robot_target: Plane, allowed_collision_pairs: list
# ---------- movement: Python ----------
from compas_fab.planning import FreeMovement, LinearMovement
from compas_rhino.geometry import RhinoPlane

if movement_type == 'FreeMovement':
    action = FreeMovement()
elif movement_type == 'LinearMovement':
    action = LinearMovement()
else:
    raise ValueError('movement type not supported')

action.robot_target = RhinoPlane.from_geometry(robot_target).to_compas_frame()

if allowed_collision_pairs is not None:
    action.allowed_collision_pairs = []
    for pair in allowed_collision_pairs:
        if pair is not None:
            action.allowed_collision_pairs.append(pair)

if fixed_configuration is not None:
    action.fixed_configuration = fixed_configuration
# ---------- end movement ----------
out = ClusterOutput(movement.out)
action = ClusterOutput(movement.action)
